# Grasshopper definition gbXML_export.gh (Grasshopper 1.0.7)

panel = Panel("C:\Users\sdmei\git\space-invader\components\gbXML_export.py")
file = ReadFile(File=panel, PerLineParse=False)
brep = Brep([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])
gbxml = GhPythonScript(Code=file, Rooms=brep, Path="C:\Users\sdmei\git\space-invader\components\test.xml")
